# Grasshopper definition 030_inverse_functions.gh (Grasshopper 1.0.7)
# plug-ins: HAL for Grasshopper

# 1.4
# Inverse Functions:
sessionsettings = SessionSettings()

# ----
# x-axis and y-axis
xy_plane = XYPlane(Origin=Point(0, 0, 0))
range = Range(Domain="5", Steps=10)
construct_point = ConstructPoint(XCoordinate=range, YCoordinate=0, ZCoordinate=0)
construct_point_2 = ConstructPoint(XCoordinate=0, YCoordinate=range, ZCoordinate=0)
list_item = ListItem(List=construct_point, Index=0, Wrap=True)  # -> Item1, Item
list_item_2 = ListItem(List=construct_point_2, Index=0, Wrap=True)  # -> Item1, Item
construct_point_3 = ConstructPoint(XCoordinate=0, YCoordinate=0, ZCoordinate=0)
vector_2pt = Vector2Pt(PointA=list_item.Item, PointB=list_item.Item1, Unitize=False)  # -> Vector, Length
vector_2pt_2 = Vector2Pt(PointA=list_item_2.Item, PointB=list_item_2.Item1, Unitize=False)  # -> Vector, Length
negative = Negative(Value=vector_2pt.Vector)
negative_2 = Negative(Value=vector_2pt_2.Vector)
vector_display = VectorDisplay(Anchor=construct_point_3, Vector=vector_2pt.Vector)
vector_display_2 = VectorDisplay(Anchor=construct_point_3, Vector=negative)
vector_display_3 = VectorDisplay(Anchor=construct_point_3, Vector=vector_2pt_2.Vector)
vector_display_4 = VectorDisplay(Anchor=construct_point_3, Vector=negative_2)
